# Grasshopper definition 01042019_CASA_BrickStacking.gh (Grasshopper 1.0.7)
# plug-ins: Fologram for Grasshopper

# ----
# INPUT
brep = Brep([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])
pt = Point(Point(-2.577547419, 12.14643326, 0))

panel = Panel("""-1
1""")
# CLICKS AS INPUTS
toggle = BooleanToggle(True)
track_clicks = TrackClicks(HitGeometry=toggle, ObjectNameFilters=panel, InRelativeSpace=True, hasBeenAddedToDocument=True)  # -> Pose, Cursor, Hand, DeviceName, Object, ID
panel_2 = Panel(track_clicks.Object)
rec = DataRecorder(panel_2, DataLimit=-10, RecordData=True)
ma = MassAddition(Input=rec)  # -> Result, PartialResults

number_slider = Slider(0.2, range=0..1)
# BUTTONS
lassm_btn_right = Geometry(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)
lassm_btn_left = Geometry(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)
scale = Scale(Geometry=lassm_btn_right, Center=pt, Factor=number_slider)  # -> Geometry, Transform
scale_2 = Scale(Geometry=lassm_btn_left, Center=pt, Factor=number_slider)  # -> Geometry, Transform
toggle_2 = BooleanToggle(True)
send_meshes = SendMeshes(
    Meshes=scale.Geometry,
    Materials=ColourSwatch(SwatchColor=RGB(0, 246, 255)),
    Name="1",
    Interactive=toggle_2,
    hasBeenAddedToDocument=True)
send_meshes_2 = SendMeshes(
    Meshes=scale_2.Geometry,
    Materials=ColourSwatch(SwatchColor=RGB(255, 0, 174)),
    Name="-1",
    Interactive=toggle_2,
    hasBeenAddedToDocument=True)

scale_3 = Scale(Geometry=brep, Center=pt, Factor=Slider(1, range=0..1))  # -> Geometry, Transform
# LAYER DISPLAY
box_corners = BoxCorners(Box=scale_3.Geometry)  # -> CornerA, CornerB, CornerC, CornerD, CornerE, CornerF, CornerG, CornerH
pdecon = Deconstruct(Point=box_corners.CornerA)  # -> XComponent, YComponent, ZComponent
int = Integer(pdecon.ZComponent)
sort = SortList(Keys=int, ValuesA=scale_3.Geometry)  # -> Keys, ValuesA
cset = CreateSet(List=sort.Keys)  # -> Set, Map
mindex = MemberIndex(Set=sort.Keys, Member=cset.Set)  # -> Index, Count
item = ListItem(List=sort.ValuesA, Index=mindex.Index, Wrap=True)  # -> simplify(Item)
viewer = ParamViewer(item)
lng = ListLength(List=viewer)
int_2 = Integer(lng)
subtraction = Subtraction(A=int_2, B=1)
addition = Addition(A=ma.Result, B=1)
subtraction_2 = Subtraction(A=subtraction, B=ma.Result)
series = Series(Start=0, Step=1, Count=ma.Result)
series_2 = Series(Start=addition, Step=1, Count=subtraction_2)
branch = TreeBranch(Tree=item, Path=series_2, MaintainPaths=True)
branch_2 = TreeBranch(Tree=item, Path=ma.Result, MaintainPaths=True)
branch_3 = TreeBranch(Tree=item, Path=series, MaintainPaths=True)
mesh = MeshBrep(
    Brep=branch_2,
    Settings={GridMaxCount=0, GridMinCount=16, JaggedSeams=False, MaxEdgeLength=0, MinEdgeLength=0.0001, MinTolerance=0, Refine=True, RefineAngle=0, RelativeTolerance=0.65, SimplePlanes=True, Tolerance=0})
send_meshes_3 = SendMeshes(Meshes=mesh, Materials=ColourSwatch(SwatchColor=RGBA(255, 157, 0, 200)), Interactive=False, hasBeenAddedToDocument=True)
send_meshes_4 = SendMeshes(Meshes=branch_3, Materials=ColourSwatch(SwatchColor=RGB(255, 206, 128)), Interactive=False, hasBeenAddedToDocument=True)
send_meshes_5 = SendMeshes(Meshes=branch, Materials=ColourSwatch(SwatchColor=RGBA(0, 0, 0, 50)), Interactive=False, hasBeenAddedToDocument=True)

# ----
# LAYER (TEXT) CLUSTER
addition_2 = Addition(A=ma.Result, B=1)
area = Area(Geometry=[scale.Geometry, scale_2.Geometry])  # -> Area, Centroid
item_2 = ListItem(List=area.Centroid, Index=0, Wrap=True)  # -> Item, Item1
avr = Average(Input=area.Centroid)
dist = Distance(PointA=item_2.Item, PointB=item_2.Item1)
X = X(num=addition_2)
division = Division(A=dist, B=Slider(6, range=0..10))
pt_2 = Point(avr)
send_text_tags = SendTextTags(Text=X, Positions=pt_2, Colors=ColourSwatch(SwatchColor=RGB(255, 255, 255)), Sizes=division, hasBeenAddedToDocument=True)

# ==== cluster X
num = ClusterInput()
num_2 = Number(num)
cluster = Cluster(A=num_2, S=num_2)
s_1 = ClusterOutput(cluster)

# ==== cluster Cluster
A = ClusterInput()
smaller = SmallerThan(FirstNumber=A, SecondNumber=0)  # -> SmallerThan, OrEqualTo
S = ClusterInput()
gate = StreamGate(Stream=S, Gate=smaller.SmallerThan)  # -> Target0, Target1
split = TextSplit(Text=gate.Target1, Separators="-")
item = ListItem(List=split, Index=0, Wrap=True)  # -> Item, Item1
concat = Concatenate(FragmentA="00", FragmentB=gate.Target0)
concat_2 = Concatenate(FragmentA="-00", FragmentB=item.Item1)
filter = StreamFilter(Gate=smaller.SmallerThan, Stream0=concat, Stream1=concat_2)
s_0 = ClusterOutput(filter)
